# Dynamo graph PK To Align By CSV.dyn (Dynamo 2.15.1.6076)

# group: CVS
file_path = Filename(".\PK BY ALIGN.csv")  # graph input

# group: Obtener localicación y texto desde CSV
boolean = BoolSelector(false)
importCSV = Data.ImportCSV(filePath=file_path, transpose=boolean)

# group: Corredor y línea base
corridor = StringInput("Corridor - (1)")  # graph input
baseline = StringInput("BL - Cl72-Cali-ALO - (1)")  # graph input

current = Autodesk.AutoCAD.DynamoNodes.Document.Current()

# group: Baseline
corridorByName = Autodesk.Civil.DynamoNodes.Selection.CorridorByName(name=corridor, document=current)
baselineByName = Autodesk.Civil.DynamoNodes.Corridor.BaselineByName(corridor=corridorByName, name=baseline)

# group: Calcular sistema de coordenadas
code_block = CodeBlock { 0; }
getItemAtIndex = List.GetItemAtIndex(list=importCSV, index=code_block)
coordinateSystemByStation = Autodesk.Civil.DynamoNodes.Baseline.CoordinateSystemByStation(baseline=baselineByName, station=getItemAtIndex)

# group: Calcular ubicación y rotación
code_block_2 = CodeBlock { 1; }
getItemAtIndex_2 = List.GetItemAtIndex(list=importCSV, index=code_block_2)
byCoordinates = Point.ByCoordinates(x=getItemAtIndex_2)
transform = Geometry.Transform(geometry=byCoordinates, cs=coordinateSystemByStation)
XAxis = CoordinateSystem.XAxis(coordinateSystem=coordinateSystemByStation)

heigh_text = DoubleSlider(2.5, range=0..100 step 0.1)  # graph input
layer_name = StringInput("0")  # graph input

# group: Model Space
modelSpace = Autodesk.AutoCAD.DynamoNodes.Document.ModelSpace(document=current)

# group: Crear texto
code_block_3 = CodeBlock { 2; }
getItemAtIndex_3 = List.GetItemAtIndex(list=importCSV, index=code_block_3)
create = Autodesk.AutoCAD.DynamoNodes.Text.Create(text=getItemAtIndex_3, insertionPoint=transform, height=heigh_text, rotation=XAxis, layer=layer_name, block=modelSpace)
