# Dynamo graph CORRIDOR_SOLIDS_SLICE.dyn (Dynamo 2.13.1.3887)

# group: CORRIDOR NAME
corridor_name = StringInput("Corridor - (1)")  # graph input

# group: DATA CORRIDOR AND ALIGNMENT
current = Autodesk.AutoCAD.DynamoNodes.Document.Current()
corridorByName = Autodesk.Civil.DynamoNodes.Selection.CorridorByName(name=corridor_name, document=current)
baselines = Autodesk.Civil.DynamoNodes.Corridor.Baselines(corridor=corridorByName)
code_block = CodeBlock(baselines=baselines) { a=baselines[0]; }

# group: DATA CORRIDOR
region_name = StringInput("VIA FERREA1")  # graph input
assembly_name = StringInput("VIA_BALASTRO")  # graph input
code_name = StringInput("Subballast")  # graph input

# group: CORRIDOR MAP
name = Autodesk.Civil.DynamoNodes.Baseline.Name(baseline=code_block)
getSolids = Autodesk.Civil.DynamoNodes.Corridor.GetSolids(corridor=corridorByName, baselineName=name, regionName=region_name, assemblyName=assembly_name, codeName=code_name)

# group: STATIONS COORDINATES & PLANE
startStation = Autodesk.Civil.DynamoNodes.Baseline.StartStation(baseline=code_block)
endStation = Autodesk.Civil.DynamoNodes.Baseline.EndStation(baseline=code_block)

# group: FRECUENCY
FRECUENCY = CodeBlock(s=startStation, e=endStation) { s+50..e..50; e; }

# group (continued): STATIONS COORDINATES & PLANE
coordinateSystemByStation = Autodesk.Civil.DynamoNodes.Baseline.CoordinateSystemByStation(baseline=code_block, station=FRECUENCY.out0)
ZXPlane = CoordinateSystem.ZXPlane(coordinateSystem=coordinateSystemByStation)

sliceByPlanes = Autodesk.AutoCAD.DynamoNodes.Solid.SliceByPlanes(solid=getSolids, planes=ZXPlane)
