# Dynamo graph CORRIDOR_SOLIDS_SLICE_ALLREGION.dyn (Dynamo 2.15.1.6076)

# group: CORRIDOR NAME
corridor_name = StringInput("TRAZADO_FERREO")  # graph input

# group: DATA CORRIDOR AND ALIGNMENT
current = Autodesk.AutoCAD.DynamoNodes.Document.Current()
corridorByName = Autodesk.Civil.DynamoNodes.Selection.CorridorByName(name=corridor_name, document=current)
baselines = Autodesk.Civil.DynamoNodes.Corridor.Baselines(corridor=corridorByName)
code_block = CodeBlock(baselines=baselines) { a=baselines[0]; }
name = Autodesk.Civil.DynamoNodes.Baseline.Name(baseline=code_block)

# group: STATIONS COORDINATES & PLANE
startStation = Autodesk.Civil.DynamoNodes.Baseline.StartStation(baseline=code_block)
endStation = Autodesk.Civil.DynamoNodes.Baseline.EndStation(baseline=code_block)

# group: FRECUENCY
FRECUENCY = CodeBlock(s=startStation, e=endStation) { s+20..e..20; e; }

# group (continued): STATIONS COORDINATES & PLANE
coordinateSystemByStation = Autodesk.Civil.DynamoNodes.Baseline.CoordinateSystemByStation(baseline=code_block, station=FRECUENCY.out0)
ZXPlane = CoordinateSystem.ZXPlane(coordinateSystem=coordinateSystemByStation)

# group: REGION1
region_name = StringInput("VIA FERREA1")  # graph input
assembly_name = StringInput("VIA_BALASTRO")  # graph input
code_name = StringInput("Subballast")  # graph input
getSolids = Autodesk.Civil.DynamoNodes.Corridor.GetSolids(corridor=corridorByName, baselineName=name, regionName=region_name, assemblyName=assembly_name, codeName=code_name)
sliceByPlanes = Autodesk.AutoCAD.DynamoNodes.Solid.SliceByPlanes(solid=getSolids, planes=ZXPlane)
code_name_2 = StringInput("Ballast")  # graph input
getSolids_2 = Autodesk.Civil.DynamoNodes.Corridor.GetSolids(corridor=corridorByName, baselineName=name, regionName=region_name, codeName=code_name_2)
sliceByPlanes_2 = Autodesk.AutoCAD.DynamoNodes.Solid.SliceByPlanes(solid=getSolids_2, planes=ZXPlane)
code_name_3 = StringInput("Rail")  # graph input
getSolids_3 = Autodesk.Civil.DynamoNodes.Corridor.GetSolids(corridor=corridorByName, baselineName=name, regionName=region_name, codeName=code_name_3)
sliceByPlanes_3 = Autodesk.AutoCAD.DynamoNodes.Solid.SliceByPlanes(solid=getSolids_3, planes=ZXPlane)

# group: REGION 2
region_name_2 = StringInput("VIA FERREA2")  # graph input
assembly_name_2 = StringInput("VIA_BALASTRO")  # graph input
code_name_4 = StringInput("Subballast")  # graph input
getSolids_4 = Autodesk.Civil.DynamoNodes.Corridor.GetSolids(corridor=corridorByName, baselineName=name, regionName=region_name_2, assemblyName=assembly_name_2, codeName=code_name_4)
sliceByPlanes_4 = Autodesk.AutoCAD.DynamoNodes.Solid.SliceByPlanes(solid=getSolids_4, planes=ZXPlane)
code_name_5 = StringInput("Ballast")  # graph input
getSolids_5 = Autodesk.Civil.DynamoNodes.Corridor.GetSolids(corridor=corridorByName, baselineName=name, regionName=region_name_2, codeName=code_name_5)
sliceByPlanes_5 = Autodesk.AutoCAD.DynamoNodes.Solid.SliceByPlanes(solid=getSolids_5, planes=ZXPlane)
code_name_6 = StringInput("Rail")  # graph input
getSolids_6 = Autodesk.Civil.DynamoNodes.Corridor.GetSolids(corridor=corridorByName, baselineName=name, regionName=region_name_2, codeName=code_name_6)
sliceByPlanes_6 = Autodesk.AutoCAD.DynamoNodes.Solid.SliceByPlanes(solid=getSolids_6, planes=ZXPlane)
