# Dynamo graph ADD_REGIONS_CORRIDOR_BY_EXCEL.dyn (Dynamo 2.15.1.6076)
# packages: Civil3DToolkit 1.1.32

# group: CORRIDOR
corridors = CorridorNameDropDown("VIA")  # graph input

baselines = Autodesk.Civil.DynamoNodes.Corridor.Baselines(corridor=corridors)

# group: FILE & SHEET
file_path = Filename(".\Book1.xlsx")  # graph input
SHEET = StringInput("DATA")  # graph input

file_from_path = FileObject(path=file_path)
boolean = BoolSelector(false)
importExcel = Data.ImportExcel(file=file_from_path, sheetName=SHEET, showExcel=boolean)
transpose = List.Transpose(lists=importExcel)
code_block = CodeBlock { 0; 1; 2; 3; }
getItemAtIndex = List.GetItemAtIndex(list=transpose, index=code_block.out2)
getItemAtIndex_2 = List.GetItemAtIndex(list=transpose, index=code_block.out3)
getItemAtIndex_3 = List.GetItemAtIndex(list=transpose, index=code_block.out0)
getItemAtIndex_4 = List.GetItemAtIndex(list=transpose, index=code_block.out1)

# group: FRENCUENCY & REBUILD
FRECUENCY = DoubleInput(20)  # graph input
REBUILD = BoolSelector(false)  # graph input

addRegion = Autodesk.Civil.DynamoNodes.CorridorExtensions.CorridorExtensions.AddRegion(baseline=baselines, name=getItemAtIndex, assemblyName=getItemAtIndex_2, start=getItemAtIndex_3, end=getItemAtIndex_4, curveFreq=FRECUENCY, profileFreq=FRECUENCY, spiralFreq=FRECUENCY, tangentFreq=FRECUENCY, rebuild=REBUILD, lacing=Longest)
