# Dynamo graph BLOCKS_CORRIDOR_BY_CSV.dyn (Dynamo 2.15.1.6076)

# group: Corridor
current = Autodesk.AutoCAD.DynamoNodes.Document.Current()
corridor = StringInput("Rail")  # graph input
baseline = StringInput("Eje")  # graph input

# group: Get Masts Location From CSV
file_path = Filename(".\POSTES.csv")  # graph input
boolean = BoolSelector(false)
importCSV = Data.ImportCSV(filePath=file_path, transpose=boolean)

# group: Get Baseline
corridorByName = Autodesk.Civil.DynamoNodes.Selection.CorridorByName(name=corridor, document=current)
baselineByName = Autodesk.Civil.DynamoNodes.Corridor.BaselineByName(corridor=corridorByName, name=baseline)

# group: Calculate CoordinateSystems
code_block = CodeBlock { 0; }
getItemAtIndex = List.GetItemAtIndex(list=importCSV, index=code_block)
coordinateSystemByStation = Autodesk.Civil.DynamoNodes.Baseline.CoordinateSystemByStation(baseline=baselineByName, station=getItemAtIndex)

# group: Calculate Location & Rotation
code_block_2 = CodeBlock { 1; }
getItemAtIndex_2 = List.GetItemAtIndex(list=importCSV, index=code_block_2)
code_block_3 = CodeBlock { 3; }
getItemAtIndex_3 = List.GetItemAtIndex(list=importCSV, index=code_block_3)
byCoordinates = Point.ByCoordinates(x=getItemAtIndex_2, z=getItemAtIndex_3)
transform = Geometry.Transform(geometry=byCoordinates, cs=coordinateSystemByStation)
XAxis = CoordinateSystem.XAxis(coordinateSystem=coordinateSystemByStation)
X = Vector.X(vector=XAxis)
Y = Vector.Y(vector=XAxis)
code_block_4 = CodeBlock(o=X, a=Y) { o; a; Math.Atan(o/-a)-90; }

# group: Model Space
modelSpace = Autodesk.AutoCAD.DynamoNodes.Document.ModelSpace(document=current)

# group: Insert Block References
code_block_5 = CodeBlock { 2; }
getItemAtIndex_4 = List.GetItemAtIndex(list=importCSV, index=code_block_5)
blockByName = Autodesk.AutoCAD.DynamoNodes.Document.BlockByName(document=current, name=getItemAtIndex_4)
currentLayer = Autodesk.AutoCAD.DynamoNodes.Document.CurrentLayer(document=current)
create = Autodesk.AutoCAD.DynamoNodes.BlockReference.Create(sourceBlock=blockByName, position=transform, rotationDegrees=code_block_4.out2, layer=currentLayer, block=modelSpace)
