# Dynamo graph PILE_CIRCULAR_BY_EXCEL_ELEV_SURFACE+FUNDA+BEAM.dyn (Dynamo 2.15.1.6076)
# packages: Civil3DToolkit 1.1.32

# group: CREATE PILES > EXCEL FILE
file_path_import_excel = Filename(".\PILE_CIRCULAR_BY_EXCEL_ELEV_SURFACE+FUNDA+CAP.xlsx")  # graph input
sheet_name_pile = StringInput("PILE")  # graph input
boolean = BoolSelector(false)

# group: CREATE PILES > LIST
file_from_path = FileObject(path=file_path_import_excel)
importExcel = Data.ImportExcel(file=file_from_path, sheetName=sheet_name_pile, showExcel=boolean)
transpose = List.Transpose(lists=importExcel)
code_block = CodeBlock { 3; }

# group: CREATE PILES > CORRIDOR
corridor_name = StringInput("Corridor - (1)")  # graph input
current = Autodesk.AutoCAD.DynamoNodes.Document.Current()
baseline_name = StringInput("BL - RAIL - (1)")  # graph input

# group: CREATE PILES > Get Baseline
corridorByName = Autodesk.Civil.DynamoNodes.Selection.CorridorByName(name=corridor_name, document=current)
baselineByName = Autodesk.Civil.DynamoNodes.Corridor.BaselineByName(corridor=corridorByName, name=baseline_name)

# group: CREATE PILES > Calculate CoordinateSystems
code_block_2 = CodeBlock { 0; }
getItemAtIndex = List.GetItemAtIndex(list=transpose, index=code_block_2)
coordinateSystemByStation = Autodesk.Civil.DynamoNodes.Baseline.CoordinateSystemByStation(baseline=baselineByName, station=getItemAtIndex)

# group: CREATE PILES > Calculate Location
code_block_3 = CodeBlock { 1; }
getItemAtIndex_2 = List.GetItemAtIndex(list=transpose, index=code_block_3)
code_block_4 = CodeBlock { 2; }
getItemAtIndex_3 = List.GetItemAtIndex(list=transpose, index=code_block_4)
byCoordinates = Point.ByCoordinates(x=getItemAtIndex_2, z=getItemAtIndex_3)
transform = Geometry.Transform(geometry=byCoordinates, cs=coordinateSystemByStation)

# group: CREATE PILES
getItemAtIndex_4 = List.GetItemAtIndex(list=transpose, index=code_block)

# group: CREATE PILES > SELECT SURFACE
surfaces = SurfaceNamesDropDown("Existing Ground")  # graph input

# group: CREATE PILES > Offset Elevation base Pile
offset_elevation_base_pile = DoubleInput(-2)  # graph input

# group: CREATE PILES > Surface elevation by Coordinates
Z = Point.Z(point=transform)
XAxis = CoordinateSystem.XAxis(coordinateSystem=coordinateSystemByStation)
X = Vector.X(vector=XAxis)
Y = Vector.Y(vector=XAxis)
byCoordinates_2 = Point.ByCoordinates(x=X, y=Y)
transform_2 = Geometry.Transform(geometry=byCoordinates_2, cs=coordinateSystemByStation)
X_2 = Point.X(point=transform_2)
Y_2 = Point.Y(point=transform_2)
elevationByXY = Autodesk.Civil.DynamoNodes.Surface.ElevationByXY(surface=surfaces, x=X_2, y=Y_2)
code_block_5 = CodeBlock(Top=Z, Bottom=elevationByXY, offset=offset_elevation_base_pile) { Top; Bottom; offset; Bottom-Top+offset; }
code_block_6 = CodeBlock(a=getItemAtIndex_3, b=code_block_5.out3) { a; b; a+b; }

# group: CREATE PILES > Layer
layer_name = StringInput("Pile")  # graph input

# group: CREATE PILES > Create Pile
byCenterPointRadius = Circle.ByCenterPointRadius(centerPoint=transform, radius=getItemAtIndex_4)
extrudeAsSolid = Curve.ExtrudeAsSolid(curve=byCenterPointRadius, distance=code_block_5.out3)
current_2 = Autodesk.AutoCAD.DynamoNodes.Document.Current()
modelSpace = Autodesk.AutoCAD.DynamoNodes.Document.ModelSpace(document=current_2)
byGeometry = Autodesk.AutoCAD.DynamoNodes.Object.ByGeometry(geometry=extrudeAsSolid, layer=layer_name, block=modelSpace)
code_block_7 = CodeBlock { 3; }
getItemAtIndex_5 = List.GetItemAtIndex(list=transpose, index=code_block_7)

# group: CREATE FUNDATION > EXCEL FILE
sheet_name_fundation = StringInput("FUNDATION")  # graph input
boolean_2 = BoolSelector(false)

# group: CREATE FUNDATION > LIST
importExcel_2 = Data.ImportExcel(file=file_from_path, sheetName=sheet_name_fundation, showExcel=boolean_2)
transpose_2 = List.Transpose(lists=importExcel_2)

# group: CREATE FUNDATION > Get Baseline
corridorByName_2 = Autodesk.Civil.DynamoNodes.Selection.CorridorByName(name=corridor_name, document=current)
baselineByName_2 = Autodesk.Civil.DynamoNodes.Corridor.BaselineByName(corridor=corridorByName_2, name=baseline_name)

# group: CREATE FUNDATION > Calculate CoordinateSystems
code_block_8 = CodeBlock { 0; }
getItemAtIndex_6 = List.GetItemAtIndex(list=transpose_2, index=code_block_8)
coordinateSystemByStation_2 = Autodesk.Civil.DynamoNodes.Baseline.CoordinateSystemByStation(baseline=baselineByName_2, station=getItemAtIndex_6)

# group: CREATE FUNDATION > Calculate Location & Rotation
code_block_9 = CodeBlock { 1; }
getItemAtIndex_7 = List.GetItemAtIndex(list=transpose_2, index=code_block_9)
byCoordinates_3 = Point.ByCoordinates(x=getItemAtIndex_7, z=code_block_6.out2)
transform_3 = Geometry.Transform(geometry=byCoordinates_3, cs=coordinateSystemByStation_2)
XAxis_2 = CoordinateSystem.XAxis(coordinateSystem=coordinateSystemByStation_2)
X_3 = Vector.X(vector=XAxis_2)
Y_3 = Vector.Y(vector=XAxis_2)
code_block_10 = CodeBlock(o=X_3, a=Y_3) { o; a; Math.Atan(o/-a)-90; }

# group: CREATE FUNDATION > Model Space
modelSpace_2 = Autodesk.AutoCAD.DynamoNodes.Document.ModelSpace(document=current)

# group: CREATE FUNDATION > Insert Block References
code_block_11 = CodeBlock { 2; }
getItemAtIndex_8 = List.GetItemAtIndex(list=transpose_2, index=code_block_11)
blockByName = Autodesk.AutoCAD.DynamoNodes.Document.BlockByName(document=current, name=getItemAtIndex_8)
currentLayer = Autodesk.AutoCAD.DynamoNodes.Document.CurrentLayer(document=current)
create = Autodesk.AutoCAD.DynamoNodes.BlockReference.Create(sourceBlock=blockByName, position=transform_3, rotationDegrees=code_block_10.out2, layer=currentLayer, block=modelSpace_2)

# group: CREATE FUNDATION > EXCEL FILE
sheet_name_beam = StringInput("BEAM")  # graph input
boolean_3 = BoolSelector(false)

# group: CREATE FUNDATION > LIST
importExcel_3 = Data.ImportExcel(file=file_from_path, sheetName=sheet_name_beam, showExcel=boolean_3)
transpose_3 = List.Transpose(lists=importExcel_3)

# group: CREATE FUNDATION > Get Baseline
corridorByName_3 = Autodesk.Civil.DynamoNodes.Selection.CorridorByName(name=corridor_name, document=current)
baselineByName_3 = Autodesk.Civil.DynamoNodes.Corridor.BaselineByName(corridor=corridorByName_3, name=baseline_name)

# group: CREATE FUNDATION > Calculate CoordinateSystems
code_block_12 = CodeBlock { 0; }
getItemAtIndex_9 = List.GetItemAtIndex(list=transpose_3, index=code_block_12)
coordinateSystemByStation_3 = Autodesk.Civil.DynamoNodes.Baseline.CoordinateSystemByStation(baseline=baselineByName_3, station=getItemAtIndex_9)

# group: CREATE FUNDATION > Calculate Location & Rotation
code_block_13 = CodeBlock { 1; }
getItemAtIndex_10 = List.GetItemAtIndex(list=transpose_3, index=code_block_13)
code_block_14 = CodeBlock { 3; }
getItemAtIndex_11 = List.GetItemAtIndex(list=transpose_3, index=code_block_14)
byCoordinates_4 = Point.ByCoordinates(x=getItemAtIndex_10, z=getItemAtIndex_11)
transform_4 = Geometry.Transform(geometry=byCoordinates_4, cs=coordinateSystemByStation_3)
XAxis_3 = CoordinateSystem.XAxis(coordinateSystem=coordinateSystemByStation_3)
X_4 = Vector.X(vector=XAxis_3)
Y_4 = Vector.Y(vector=XAxis_3)
code_block_15 = CodeBlock(o=X_4, a=Y_4) { o; a; Math.Atan(o/-a)-90; }

# group: CREATE FUNDATION > Model Space
modelSpace_3 = Autodesk.AutoCAD.DynamoNodes.Document.ModelSpace(document=current)

# group: CREATE FUNDATION > Insert Block References
code_block_16 = CodeBlock { 2; }
getItemAtIndex_12 = List.GetItemAtIndex(list=transpose_3, index=code_block_16)
blockByName_2 = Autodesk.AutoCAD.DynamoNodes.Document.BlockByName(document=current, name=getItemAtIndex_12)
currentLayer_2 = Autodesk.AutoCAD.DynamoNodes.Document.CurrentLayer(document=current)
create_2 = Autodesk.AutoCAD.DynamoNodes.BlockReference.Create(sourceBlock=blockByName_2, position=transform_4, rotationDegrees=code_block_15.out2, layer=currentLayer_2, block=modelSpace_3)
