# Dynamo graph PIER_BY_EXCEL_ELEV_SURFACE+FUNDA+CAP+BUTMENT.dyn "PIER_BY_EXCEL_ELEV_SURFACE+FUNDA+BEAM+BUTMENT" (Dynamo 2.15.1.6076)
# packages: Civil3DToolkit 1.1.32

# group: CREATE PILES > CORRIDOR
current = Autodesk.AutoCAD.DynamoNodes.Document.Current()
corridor_name = StringInput("S01")  # graph input
baseline_name = StringInput("BL - SUBTRAMO1 - (10)")  # graph input

# group: CREATE PILES > EXCEL FILE
file_path_import_excel = Filename(".\PIER_BY_EXCEL_ELEV_SURFACE+FUNDA+BEAM+BUTMENT.xlsx")  # graph input
sheet_name_pile = StringInput("PILE2")  # graph input
boolean = BoolSelector(false)

# group: CREATE PILES > LIST
file_from_path = FileObject(path=file_path_import_excel)
importExcel = Data.ImportExcel(file=file_from_path, sheetName=sheet_name_pile, showExcel=boolean)
transpose = List.Transpose(lists=importExcel)

# group: CREATE FUNDATION > EXCEL FILE
sheet_name_fundation = StringInput("FUNDATION")  # graph input
boolean_2 = BoolSelector(false)

# group: CREATE FUNDATION > LIST
importExcel_2 = Data.ImportExcel(file=file_from_path, sheetName=sheet_name_fundation, showExcel=boolean_2)
transpose_2 = List.Transpose(lists=importExcel_2)

# group: CREATE PILES > Get Baseline
corridorByName = Autodesk.Civil.DynamoNodes.Selection.CorridorByName(name=corridor_name, document=current)
baselineByName = Autodesk.Civil.DynamoNodes.Corridor.BaselineByName(corridor=corridorByName, name=baseline_name)

# group: CREATE PILES > Calculate CoordinateSystems
code_block = CodeBlock { 0; }
getItemAtIndex = List.GetItemAtIndex(list=transpose, index=code_block)
coordinateSystemByStation = Autodesk.Civil.DynamoNodes.Baseline.CoordinateSystemByStation(baseline=baselineByName, station=getItemAtIndex)

# group: CREATE PILES > Calculate Location
code_block_2 = CodeBlock { 3; }
getItemAtIndex_2 = List.GetItemAtIndex(list=transpose, index=code_block_2)
code_block_3 = CodeBlock { 1; }
getItemAtIndex_3 = List.GetItemAtIndex(list=transpose, index=code_block_3)
byCoordinates = Point.ByCoordinates(x=getItemAtIndex_3, z=getItemAtIndex_2)
transform = Geometry.Transform(geometry=byCoordinates, cs=coordinateSystemByStation)

# group: CREATE PILES > SELECT SURFACE
surfaces = SurfaceNamesDropDown("Superficie_Terreno_SubTr01")  # graph input

# group: CREATE PILES > Offset Elevation base Pile
offset_elevation_base_pile = DoubleInput(-2)  # graph input

# group: CREATE PILES > Surface elevation by Coordinates
Z = Point.Z(point=transform)
XAxis = CoordinateSystem.XAxis(coordinateSystem=coordinateSystemByStation)
X = Vector.X(vector=XAxis)
Y = Vector.Y(vector=XAxis)
byCoordinates_2 = Point.ByCoordinates(x=X, y=Y)
transform_2 = Geometry.Transform(geometry=byCoordinates_2, cs=coordinateSystemByStation)
X_2 = Point.X(point=transform_2)
Y_2 = Point.Y(point=transform_2)
elevationByXY = Autodesk.Civil.DynamoNodes.Surface.ElevationByXY(surface=surfaces, x=X_2, y=Y_2)
code_block_4 = CodeBlock(Top=Z, Bottom=elevationByXY, offset=offset_elevation_base_pile) { Top; Bottom; offset; Bottom-Top+offset; }
code_block_5 = CodeBlock(a=getItemAtIndex_2, b=code_block_4.out3) { a; b; a+b; }

# group: CREATE FUNDATION > Get Baseline
corridorByName_2 = Autodesk.Civil.DynamoNodes.Selection.CorridorByName(name=corridor_name, document=current)
baselineByName_2 = Autodesk.Civil.DynamoNodes.Corridor.BaselineByName(corridor=corridorByName_2, name=baseline_name)

# group: CREATE FUNDATION > Calculate CoordinateSystems
code_block_6 = CodeBlock { 0; }
getItemAtIndex_4 = List.GetItemAtIndex(list=transpose_2, index=code_block_6)
coordinateSystemByStation_2 = Autodesk.Civil.DynamoNodes.Baseline.CoordinateSystemByStation(baseline=baselineByName_2, station=getItemAtIndex_4)

# group: CREATE FUNDATION > Calculate Location & Rotation
code_block_7 = CodeBlock { 1; }
getItemAtIndex_5 = List.GetItemAtIndex(list=transpose_2, index=code_block_7)
byCoordinates_3 = Point.ByCoordinates(x=getItemAtIndex_5, z=code_block_5.out2)
transform_3 = Geometry.Transform(geometry=byCoordinates_3, cs=coordinateSystemByStation_2)
XAxis_2 = CoordinateSystem.XAxis(coordinateSystem=coordinateSystemByStation_2)
X_3 = Vector.X(vector=XAxis_2)
Y_3 = Vector.Y(vector=XAxis_2)
code_block_8 = CodeBlock(o=X_3, a=Y_3) { o; a; Math.Atan(o/-a)-90; }

# group: CREATE FUNDATION > Model Space
modelSpace = Autodesk.AutoCAD.DynamoNodes.Document.ModelSpace(document=current)

# group: CREATE FUNDATION > Insert Block References
code_block_9 = CodeBlock { 2; }
getItemAtIndex_6 = List.GetItemAtIndex(list=transpose_2, index=code_block_9)
blockByName = Autodesk.AutoCAD.DynamoNodes.Document.BlockByName(document=current, name=getItemAtIndex_6)
currentLayer = Autodesk.AutoCAD.DynamoNodes.Document.CurrentLayer(document=current)
create = Autodesk.AutoCAD.DynamoNodes.BlockReference.Create(sourceBlock=blockByName, position=transform_3, rotationDegrees=code_block_8.out2, layer=currentLayer, block=modelSpace)

# group: CREATE BEAM > EXCEL FILE
sheet_name_beam = StringInput("CAP")  # graph input
boolean_3 = BoolSelector(false)

# group: CREATE BEAM > LIST
importExcel_3 = Data.ImportExcel(file=file_from_path, sheetName=sheet_name_beam, showExcel=boolean_3)
transpose_3 = List.Transpose(lists=importExcel_3)

# group: CREATE BEAM > Get Baseline
corridorByName_3 = Autodesk.Civil.DynamoNodes.Selection.CorridorByName(name=corridor_name, document=current)
baselineByName_3 = Autodesk.Civil.DynamoNodes.Corridor.BaselineByName(corridor=corridorByName_3, name=baseline_name)

# group: CREATE BEAM > Calculate CoordinateSystems
code_block_10 = CodeBlock { 0; }
getItemAtIndex_7 = List.GetItemAtIndex(list=transpose_3, index=code_block_10)
coordinateSystemByStation_3 = Autodesk.Civil.DynamoNodes.Baseline.CoordinateSystemByStation(baseline=baselineByName_3, station=getItemAtIndex_7)

# group: CREATE BEAM > Calculate Location & Rotation
code_block_11 = CodeBlock { 1; }
getItemAtIndex_8 = List.GetItemAtIndex(list=transpose_3, index=code_block_11)
code_block_12 = CodeBlock { 3; }
getItemAtIndex_9 = List.GetItemAtIndex(list=transpose_3, index=code_block_12)
byCoordinates_4 = Point.ByCoordinates(x=getItemAtIndex_8, z=getItemAtIndex_9)
transform_4 = Geometry.Transform(geometry=byCoordinates_4, cs=coordinateSystemByStation_3)
XAxis_3 = CoordinateSystem.XAxis(coordinateSystem=coordinateSystemByStation_3)
X_4 = Vector.X(vector=XAxis_3)
Y_4 = Vector.Y(vector=XAxis_3)
code_block_13 = CodeBlock(o=X_4, a=Y_4) { o; a; Math.Atan(o/-a)-90; }

# group: CREATE BEAM > Model Space
modelSpace_2 = Autodesk.AutoCAD.DynamoNodes.Document.ModelSpace(document=current)

# group: CREATE BEAM > Insert Block References
code_block_14 = CodeBlock { 2; }
getItemAtIndex_10 = List.GetItemAtIndex(list=transpose_3, index=code_block_14)
blockByName_2 = Autodesk.AutoCAD.DynamoNodes.Document.BlockByName(document=current, name=getItemAtIndex_10)
currentLayer_2 = Autodesk.AutoCAD.DynamoNodes.Document.CurrentLayer(document=current)
create_2 = Autodesk.AutoCAD.DynamoNodes.BlockReference.Create(sourceBlock=blockByName_2, position=transform_4, rotationDegrees=code_block_13.out2, layer=currentLayer_2, block=modelSpace_2)

# group: CREATE PIER TOP > EXCEL FILE
sheet_name_beam_2 = StringInput("PILE2")  # graph input
boolean_4 = BoolSelector(false)

# group: CREATE PIER TOP > LIST
importExcel_4 = Data.ImportExcel(file=file_from_path, sheetName=sheet_name_beam_2, showExcel=boolean_4)
transpose_4 = List.Transpose(lists=importExcel_4)

# group: CREATE PIER TOP > Get Baseline
corridorByName_4 = Autodesk.Civil.DynamoNodes.Selection.CorridorByName(name=corridor_name, document=current)
baselineByName_4 = Autodesk.Civil.DynamoNodes.Corridor.BaselineByName(corridor=corridorByName_4, name=baseline_name)

# group: CREATE PIER TOP > Calculate CoordinateSystems
code_block_15 = CodeBlock { 0; }
getItemAtIndex_11 = List.GetItemAtIndex(list=transpose_4, index=code_block_15)
coordinateSystemByStation_4 = Autodesk.Civil.DynamoNodes.Baseline.CoordinateSystemByStation(baseline=baselineByName_4, station=getItemAtIndex_11)

# group: CREATE PIER TOP > Calculate Location & Rotation
code_block_16 = CodeBlock { 1; }
getItemAtIndex_12 = List.GetItemAtIndex(list=transpose_4, index=code_block_16)
code_block_17 = CodeBlock { 3; }
getItemAtIndex_13 = List.GetItemAtIndex(list=transpose_4, index=code_block_17)
byCoordinates_5 = Point.ByCoordinates(x=getItemAtIndex_12, z=getItemAtIndex_13)
transform_5 = Geometry.Transform(geometry=byCoordinates_5, cs=coordinateSystemByStation_4)
XAxis_4 = CoordinateSystem.XAxis(coordinateSystem=coordinateSystemByStation_4)
X_5 = Vector.X(vector=XAxis_4)
Y_5 = Vector.Y(vector=XAxis_4)
code_block_18 = CodeBlock(o=X_5, a=Y_5) { o; a; Math.Atan(o/-a)-90; }

# group: CREATE PIER TOP > Model Space
modelSpace_3 = Autodesk.AutoCAD.DynamoNodes.Document.ModelSpace(document=current)

# group: CREATE PIER TOP > Insert Block References
code_block_19 = CodeBlock { 2; }
getItemAtIndex_14 = List.GetItemAtIndex(list=transpose_4, index=code_block_19)
blockByName_3 = Autodesk.AutoCAD.DynamoNodes.Document.BlockByName(document=current, name=getItemAtIndex_14)
currentLayer_3 = Autodesk.AutoCAD.DynamoNodes.Document.CurrentLayer(document=current)
create_3 = Autodesk.AutoCAD.DynamoNodes.BlockReference.Create(sourceBlock=blockByName_3, position=transform_5, rotationDegrees=code_block_18.out2, layer=currentLayer_3, block=modelSpace_3)

# group: CREATE PIER BOTTOM > EXCEL FILE
sheet_name_beam_3 = StringInput("PILE2")  # graph input
boolean_5 = BoolSelector(false)

# group: CREATE PIER BOTTOM > LIST
importExcel_5 = Data.ImportExcel(file=file_from_path, sheetName=sheet_name_beam_3, showExcel=boolean_5)
transpose_5 = List.Transpose(lists=importExcel_5)

# group: CREATE PIER BOTTOM > Get Baseline
corridorByName_5 = Autodesk.Civil.DynamoNodes.Selection.CorridorByName(name=corridor_name, document=current)
baselineByName_5 = Autodesk.Civil.DynamoNodes.Corridor.BaselineByName(corridor=corridorByName_5, name=baseline_name)

# group: CREATE PIER BOTTOM > Calculate CoordinateSystems
code_block_20 = CodeBlock { 0; }
getItemAtIndex_15 = List.GetItemAtIndex(list=transpose_5, index=code_block_20)
coordinateSystemByStation_5 = Autodesk.Civil.DynamoNodes.Baseline.CoordinateSystemByStation(baseline=baselineByName_5, station=getItemAtIndex_15)

# group: CREATE PIER BOTTOM > Calculate Location & Rotation
code_block_21 = CodeBlock { 1; }
getItemAtIndex_16 = List.GetItemAtIndex(list=transpose_5, index=code_block_21)
byCoordinates_6 = Point.ByCoordinates(x=getItemAtIndex_16, z=code_block_5.out2)
transform_6 = Geometry.Transform(geometry=byCoordinates_6, cs=coordinateSystemByStation_5)
XAxis_5 = CoordinateSystem.XAxis(coordinateSystem=coordinateSystemByStation_5)
X_6 = Vector.X(vector=XAxis_5)
Y_6 = Vector.Y(vector=XAxis_5)
code_block_22 = CodeBlock(o=X_6, a=Y_6) { o; a; Math.Atan(o/-a)-90; }

# group: CREATE PIER BOTTOM > Model Space
modelSpace_4 = Autodesk.AutoCAD.DynamoNodes.Document.ModelSpace(document=current)

# group: CREATE PIER BOTTOM > Insert Block References
code_block_23 = CodeBlock { 2; }
getItemAtIndex_17 = List.GetItemAtIndex(list=transpose_5, index=code_block_23)
blockByName_4 = Autodesk.AutoCAD.DynamoNodes.Document.BlockByName(document=current, name=getItemAtIndex_17)
currentLayer_4 = Autodesk.AutoCAD.DynamoNodes.Document.CurrentLayer(document=current)
create_4 = Autodesk.AutoCAD.DynamoNodes.BlockReference.Create(sourceBlock=blockByName_4, position=transform_6, rotationDegrees=code_block_22.out2, layer=currentLayer_4, block=modelSpace_4)

# group: CREATE ABUTMENT TOP > EXCEL FILE
sheet_name_beam_4 = StringInput("ABUT")  # graph input
boolean_6 = BoolSelector(false)

# group: CREATE ABUTMENT TOP > LIST
importExcel_6 = Data.ImportExcel(file=file_from_path, sheetName=sheet_name_beam_4, showExcel=boolean_6)
transpose_6 = List.Transpose(lists=importExcel_6)

# group: CREATE ABUTMENT TOP > Get Baseline
corridorByName_6 = Autodesk.Civil.DynamoNodes.Selection.CorridorByName(name=corridor_name, document=current)
baselineByName_6 = Autodesk.Civil.DynamoNodes.Corridor.BaselineByName(corridor=corridorByName_6, name=baseline_name)

# group: CREATE ABUTMENT TOP > Calculate CoordinateSystems
code_block_24 = CodeBlock { 0; }
getItemAtIndex_18 = List.GetItemAtIndex(list=transpose_6, index=code_block_24)
coordinateSystemByStation_6 = Autodesk.Civil.DynamoNodes.Baseline.CoordinateSystemByStation(baseline=baselineByName_6, station=getItemAtIndex_18)

# group: CREATE ABUTMENT TOP > Calculate Location & Rotation
code_block_25 = CodeBlock { 1; }
getItemAtIndex_19 = List.GetItemAtIndex(list=transpose_6, index=code_block_25)
code_block_26 = CodeBlock { 3; }
getItemAtIndex_20 = List.GetItemAtIndex(list=transpose_6, index=code_block_26)
byCoordinates_7 = Point.ByCoordinates(x=getItemAtIndex_19, z=getItemAtIndex_20)
transform_7 = Geometry.Transform(geometry=byCoordinates_7, cs=coordinateSystemByStation_6)
XAxis_6 = CoordinateSystem.XAxis(coordinateSystem=coordinateSystemByStation_6)
X_7 = Vector.X(vector=XAxis_6)
Y_7 = Vector.Y(vector=XAxis_6)
code_block_27 = CodeBlock(o=X_7, a=Y_7) { o; a; Math.Atan(o/-a)-90; }

# group: CREATE ABUTMENT TOP > Model Space
modelSpace_5 = Autodesk.AutoCAD.DynamoNodes.Document.ModelSpace(document=current)

# group: CREATE ABUTMENT TOP > Insert Block References
code_block_28 = CodeBlock { 2; }
getItemAtIndex_21 = List.GetItemAtIndex(list=transpose_6, index=code_block_28)
blockByName_5 = Autodesk.AutoCAD.DynamoNodes.Document.BlockByName(document=current, name=getItemAtIndex_21)
currentLayer_5 = Autodesk.AutoCAD.DynamoNodes.Document.CurrentLayer(document=current)
create_5 = Autodesk.AutoCAD.DynamoNodes.BlockReference.Create(sourceBlock=blockByName_5, position=transform_7, rotationDegrees=code_block_27.out2, layer=currentLayer_5, block=modelSpace_5)
