# Dynamo graph Select_by_Pstes.dyn (Dynamo 2.15.1.6076)
# packages: Camber 4.2.6

current = Autodesk.AutoCAD.DynamoNodes.Document.Current()

# group: PROPERTY SET DEFINITION NAME
property_set_definition_name = StringInput("Corridor Shape Information")  # graph input

FIELD = StringInput("AssemblyName")
valor = StringInput("TDP_PUENTE_CAJON")  # graph input
value_operators = ValueOperators("=")
objectsByProperty = AcObjectsByProperty(document=current, propertySetName=property_set_definition_name, propertyName=FIELD, propertyValue=valor, valueOperator=value_operators)
flatten = List.Flatten(list=objectsByProperty)
select = Camber.AutoCAD.Objects.Object.Select(objects=flatten)
