# Dynamo graph EXPORT_EXCEL_PSET_VALUE_BY_SELECT.dyn (Dynamo 2.15.1.6076)
# packages: Civil3DToolkit 1.1.32

select_objects = ObjectsSelection()  # 7 picked in the model

# group: GET-Property Sets and Property Names and Values
propertySets = Autodesk.AutoCAD.DynamoNodes.Object.PropertySets(object=select_objects)
properties = Autodesk.AutoCAD.DynamoNodes.PropertySet.Properties(propertySet=propertySets)
name = Autodesk.AutoCAD.DynamoNodes.Property.Name(property=properties)
value = Autodesk.AutoCAD.DynamoNodes.Property.Value(property=properties)
code_block = CodeBlock(PropNames=name, PropValues=value) { PropNames; PropValues; }

# group: PROCESS-Sort
code_block_2 = CodeBlock(PropNames=code_block.PropNames, PropValues=code_block.PropValues) { PropNames; PropValues; }
sortByKey = List.SortByKey(list=code_block_2.PropValues@L2, keys=code_block_2.PropNames@@L2)

# group: PROCESS-Prep Column Titles
code_block_3 = CodeBlock { "Civil Object Type"; }
code_block_4 = CodeBlock(keys=sortByKey.sortedKeys) { keys; }
firstItem = List.FirstItem(list=code_block_4@L4)
flatten = List.Flatten(list=firstItem)
addItemToFront = List.AddItemToFront(item=code_block_3, list=flatten)

# group: PROCESS-Add List Level
code_block_5 = CodeBlock(names=addItemToFront) { names; }
code_block_6 = CodeBlock { 0; }
getItemAtIndex = List.GetItemAtIndex(list=code_block_5@L3, index=code_block_6)

string_from_object = FromObject(object=select_objects)

# group: PROCESS-Property Set Properties and Values
code_block_7 = CodeBlock(names=string_from_object, values=sortByKey.sortedList) { names; values; }
flatten_2 = List.Flatten(list=code_block_7.values@L3)
addItemToFront_2 = List.AddItemToFront(item=code_block_7.names@L1, list=flatten_2@L2)

# group: PROCESS-List Combine and Prep for Export
join = List.Join(list0=getItemAtIndex, list1=addItemToFront_2)
transpose = List.Transpose(lists=join)

file_path = Filename("C:\Users\a.hernandez\OneDrive - EGIS Group\Escritorio\Nueva carpeta\TR6_GEO_DATA_EXPORT.xlsx")  # graph input
sheet_name = StringInput("DATA")  # graph input
code_block_8 = CodeBlock { 0; }
boolean = BoolSelector(true)
exportToExcel = Data.ExportToExcel(filePath=file_path, sheetName=sheet_name, startRow=code_block_8, startColumn=code_block_8, data=join, overWrite=boolean, writeAsString=boolean)
