# Dynamo graph Select_by_Handle.dyn (Dynamo 2.15.1.6076)
# packages: Camber 4.2.6

current = Autodesk.AutoCAD.DynamoNodes.Document.Current()

# group: PROPERTY SET DEFINITION NAME
property_set_definition_name = StringInput("Element")  # graph input

string = StringInput("Handle")

# group: EXCEL
file_path = Filename(".\HANDLE_NUMBER.xlsx")  # graph input
sheet_name = StringInput("Hoja1")  # graph input

# group: DATA
file_from_path = FileObject(path=file_path)
boolean = BoolSelector(true)
boolean_2 = BoolSelector(false)
importExcel = Data.ImportExcel(file=file_from_path, sheetName=sheet_name, readAsStrings=boolean, showExcel=boolean_2)
transpose = List.Transpose(lists=importExcel)
number = DoubleInput(0)

handle = List.GetItemAtIndex(list=transpose, index=number)
value_operators = ValueOperators("=")
objectsByProperty = AcObjectsByProperty(document=current, propertySetName=property_set_definition_name, propertyName=string, propertyValue=handle, valueOperator=value_operators)
flatten = List.Flatten(list=objectsByProperty)
select = Camber.AutoCAD.Objects.Object.Select(objects=flatten)
