# Dynamo graph EXPORT_TABLE_TO_EXCEL.dyn (Dynamo 2.19.4.6671)
# author: ALEJANDRO HERNANDEZ
# EXPORT TABLES TO EXCEL
# packages: Arkance Systems 7.4.0

file_path = Filename(".\Nuevo Hoja de cálculo de Microsoft Excel.xlsx")  # graph input
sheet_name = StringInput("Hoja1")  # graph input
number = DoubleInput(0)
select_table = ObjectSelection()  # 1 picked in the model; graph input
getFromObject = Civil3D.Annotation.Table.Civil3DTable.GetFromObject(object=select_table)
allData = Civil3D.Annotation.Table.Civil3DTable.AllData(civil3DTable=getFromObject)
exportToExcel = Data.ExportToExcel(filePath=file_path, sheetName=sheet_name, startRow=number, startColumn=number, data=allData)  # graph output
